# Dynamo graph Main1.dyn (Dynamo 1.3.4.6666)

number = DoubleInput(1..700..5)
select_model_element = DSModelElementSelection()  # 1 picked in the model
select_model_element_2 = DSModelElementSelection()  # 1 picked in the model
create = List.Create(select_model_element, select_model_element_2)
curves = Element.Curves(create)
flatten = Flatten(curves)
byLoft = Surface.ByLoft(flatten)
number_2 = DoubleInput(50)
number_3 = DoubleInput(0..1..#n2, number_2, lacing=Longest)
number_4 = DoubleInput(20)
number_5 = DoubleInput(0..1..#n1, number_4, lacing=Longest)
pointAtParameter = Surface.PointAtParameter(surface=byLoft, u=number_3, v=number_5, lacing=CrossProduct)
python_script = Python(IN[0]=pointAtParameter)
# ---------- python_script.python (11 lines) ----------
import clr
clr.AddReference('ProtoGeometry')
from Autodesk.DesignScript.Geometry import *
import sys
sys.path.append("C:\Users\Windows 10\Documents\LearnPython") 
import lesson5
#The inputs to this node will be stored as a list in the IN variables.
listInput = IN
outPut= lesson5.GetIndexList(UnwrapElement(IN[0]))
#Assign your output to the OUT variable.
OUT =outPut
# ----------------------------------------
python_script_2 = Python(IN[0]=pointAtParameter)
# ---------- python_script_2.python (11 lines) ----------
import clr
clr.AddReference('ProtoGeometry')
from Autodesk.DesignScript.Geometry import *
import sys
sys.path.append("C:\Users\Windows 10\Documents\LearnPython") 
import lesson5
#The inputs to this node will be stored as a list in the IN variables.
listInput = IN
outPut= lesson5.GetIndexList1(UnwrapElement(IN[0]))
#Assign your output to the OUT variable.
OUT = outPut
# ----------------------------------------
python_script_3 = Python(IN[0]=python_script, IN[1]=python_script_2)
# ---------- python_script_3.python (10 lines) ----------
import clr
clr.AddReference('ProtoGeometry')
from Autodesk.DesignScript.Geometry import *
import sys
sys.path.append("C:\Users\Windows 10\Documents\LearnPython") 
import lesson5
#The inputs to this node will be stored as a list in the IN variables.
listOutput = lesson5.MakeForPoint(UnwrapElement(IN[0]),UnwrapElement(IN[1]))
#Assign your output to the OUT variable.
OUT =listOutput
# ----------------------------------------
python_script_4 = Python(IN[0]=number, IN[1]=python_script_3)
# ---------- python_script_4.python (10 lines) ----------
import clr
clr.AddReference('ProtoGeometry')
from Autodesk.DesignScript.Geometry import *
import sys
sys.path.append("C:\Users\Windows 10\Documents\LearnPython") 
import lesson5
#The inputs to this node will be stored as a list in the IN variables.
listOutput = lesson5.RemovePointIndex(UnwrapElement(IN[0]),UnwrapElement(IN[1]))
#Assign your output to the OUT variable.
OUT = listOutput
# ----------------------------------------
family_types = FamilyTypes("Family3:Family3")
byPoints = AdaptiveComponent.ByPoints(points=python_script_4, familyType=family_types)
python_script_5 = Python(IN[0]=python_script, IN[1]=python_script_2)
# ---------- python_script_5.python (10 lines) ----------
import clr
clr.AddReference('ProtoGeometry')
from Autodesk.DesignScript.Geometry import *
import sys
sys.path.append("C:\Users\Windows 10\Documents\LearnPython") 
import lesson5
#The inputs to this node will be stored as a list in the IN variables.
listOutput = lesson5.MakeForPoint2(UnwrapElement(IN[0]),UnwrapElement(IN[1]))
#Assign your output to the OUT variable.
OUT = listOutput
# ----------------------------------------
family_types_2 = FamilyTypes("Family4:Family4")
byPoints_2 = AdaptiveComponent.ByPoints(points=python_script_5, familyType=family_types_2)
transpose = List.Transpose(pointAtParameter)
transpose_2 = List.Transpose(pointAtParameter)
python_script_6 = Python(IN[0]=transpose, IN[1]=transpose_2)
# ---------- python_script_6.python (13 lines) ----------
import clr
clr.AddReference('ProtoGeometry')
from Autodesk.DesignScript.Geometry import *
import sys
sys.path.append("C:\Users\Windows 10\Documents\LearnPython") 
import lesson5
#The inputs to this node will be stored as a list in the IN variables.
listFirst = UnwrapElement(IN[0])
listNext= UnwrapElement(IN[1])
listOut= lesson5.Make3Point(listFirst,listNext)

#Assign your output to the OUT variable.
OUT =listOut
# ----------------------------------------
family_types_3 = FamilyTypes("Family5:Family5")
byPoints_3 = AdaptiveComponent.ByPoints(points=python_script_6, familyType=family_types_3)
count = List.Count(transpose)
code_block = CodeBlock(n=count) { n-1; n-2; }
getItemAtIndex = List.GetItemAtIndex(list=transpose@L3, index=code_block.out0)
getItemAtIndex_2 = List.GetItemAtIndex(list=transpose@L3, index=code_block.out1)
python_script_7 = Python(IN[0]=getItemAtIndex, IN[1]=getItemAtIndex_2)
# ---------- python_script_7.python (12 lines) ----------
import clr
clr.AddReference('ProtoGeometry')
from Autodesk.DesignScript.Geometry import *
import sys
sys.path.append("C:\Users\Windows 10\Documents\LearnPython") 
import lesson5
#The inputs to this node will be stored as a list in the IN variables.
listFirst = UnwrapElement(IN[0])
listNext= UnwrapElement(IN[1])
listOut= lesson5.Make3Point2(listFirst,listNext)
#Assign your output to the OUT variable.
OUT = listOut
# ----------------------------------------
family_types_4 = FamilyTypes("Family6:Family6")
byPoints_4 = AdaptiveComponent.ByPoints(points=python_script_7, familyType=family_types_4)
code_block_2 = CodeBlock { 0; }
getItemAtIndex_3 = List.GetItemAtIndex(list=pointAtParameter@L3, index=code_block_2)
code_block_3 = CodeBlock { 1; }
getItemAtIndex_4 = List.GetItemAtIndex(list=pointAtParameter@L3, index=code_block_3)
python_script_8 = Python(IN[0]=getItemAtIndex_3, IN[1]=getItemAtIndex_4)
# ---------- python_script_8.python (12 lines) ----------
import clr
clr.AddReference('ProtoGeometry')
from Autodesk.DesignScript.Geometry import *
import sys
sys.path.append("C:\Users\Windows 10\Documents\LearnPython") 
import lesson5
#The inputs to this node will be stored as a list in the IN variables.
listFirst = UnwrapElement(IN[0])
listNext= UnwrapElement(IN[1])
listOut= lesson5.Make3Point3(listFirst,listNext)
#Assign your output to the OUT variable.
OUT =listOut
# ----------------------------------------
family_types_5 = FamilyTypes("Family5:Family5")
byPoints_5 = AdaptiveComponent.ByPoints(points=python_script_8, familyType=family_types_5)
count_2 = List.Count(pointAtParameter)
code_block_4 = CodeBlock(n=count_2) { n-1; n-2; }
getItemAtIndex_5 = List.GetItemAtIndex(list=pointAtParameter@L3, index=code_block_4.out0)
getItemAtIndex_6 = List.GetItemAtIndex(list=pointAtParameter@L3, index=code_block_4.out1)
python_script_9 = Python(IN[0]=getItemAtIndex_5, IN[1]=getItemAtIndex_6)
# ---------- python_script_9.python (12 lines) ----------
import clr
clr.AddReference('ProtoGeometry')
from Autodesk.DesignScript.Geometry import *
import sys
sys.path.append("C:\Users\Windows 10\Documents\LearnPython") 
import lesson5
#The inputs to this node will be stored as a list in the IN variables.
listFirst = UnwrapElement(IN[0])
listNext= UnwrapElement(IN[1])
listOut= lesson5.Make3Point4(listFirst,listNext)
#Assign your output to the OUT variable.
OUT =listOut
# ----------------------------------------
family_types_6 = FamilyTypes("Family6:Family6")
byPoints_6 = AdaptiveComponent.ByPoints(points=python_script_9, familyType=family_types_6)
