# Dynamo graph PointDynamo.dyn (Dynamo 1.3.4.6666)

file_path = Filename(".\excel91.xlsx")
fromPath = FileObject(file_path)  # "File.FromPath"
code_block = CodeBlock { "DynamoPoint1"; }
pointExcel = Custom[PointExcel](fromPath, code_block)
file_path_2 = Filename(".\excel91.xlsx")
fromPath_2 = FileObject(file_path_2)  # "File.FromPath"
code_block_2 = CodeBlock { "DynamoPoint2"; }
pointExcel_2 = Custom[PointExcel](fromPath_2, code_block_2)
file_path_3 = Filename(".\excel91.xlsx")
fromPath_3 = FileObject(file_path_3)  # "File.FromPath"
code_block_3 = CodeBlock { "DynamoPoint3"; }
pointExcel_3 = Custom[PointExcel](fromPath_3, code_block_3)
create = List.Create(pointExcel, pointExcel_2, pointExcel_3)
byLoft = Surface.ByLoft(create)
file_path_4 = Filename(".\surfacesat.sat")
exportToSAT = ExportWithUnits(byLoft, file_path_4, exportedUnit=Meters)
