# Dynamo custom node PointExcel.dyf (Dynamo 1.3.4.6666)
# category: Core

Input = Input()
Input_2 = Input()
readFromFile = Excel.ReadFromFile(file=Input, sheetName=Input_2)
transpose = List.Transpose(readFromFile)
code_block = CodeBlock { 0; }
getItemAtIndex = List.GetItemAtIndex(list=transpose, index=code_block)
removeItemAtIndex = List.RemoveItemAtIndex(list=getItemAtIndex, indices=code_block)
code_block_2 = CodeBlock { 1; }
getItemAtIndex_2 = List.GetItemAtIndex(list=transpose, index=code_block_2)
removeItemAtIndex_2 = List.RemoveItemAtIndex(list=getItemAtIndex_2, indices=code_block)
code_block_3 = CodeBlock { 2; }
getItemAtIndex_3 = List.GetItemAtIndex(list=transpose, index=code_block_3)
removeItemAtIndex_3 = List.RemoveItemAtIndex(list=getItemAtIndex_3, indices=code_block)
byCoordinates = Point.ByCoordinates(x=removeItemAtIndex, y=removeItemAtIndex_2, z=removeItemAtIndex_3)
byControlPoints = NurbsCurve.ByControlPoints(byCoordinates)
Output = Output(byControlPoints)  # ""
